# Grasshopper definition comparison_of_volume_calculation.gh (Grasshopper 1.0.7)
# plug-ins: Excel, Pufferfish, MeshEdit Components, Human

panel = Panel("3FCE82CC-86BE-4487-9677-D2B9E654B22F")
file_path = FilePath("C:\Users\THINK\Documents\GitHub\thesis-material-inventory\Luucy\geb_zh_test_building_volume_floor_area.xlsx")
file_path_2 = FilePath("C:\Users\THINK\Documents\GitHub\thesis-material-inventory\Luucy\geb_zh_test_1m_raster.xlsx")

# ---- group: terrain
mesh = Mesh(<mesh referenced from the Rhino model>)

# ----
mesh_2 = Mesh(<mesh referenced from the Rhino model>)
excelread = ExcelRead(Start=Toggle(True), FilePath=file_path, SheetName="Swissbuilding Analytics - buili", Range="A1:D83")
excelread_2 = ExcelRead(Start=Toggle(True), FilePath=file_path_2, SheetName="geb_zh_test_1m_raster", Range="A1:F11923")
explode_tree = ExplodeTree(Data=excelread)  # -> Branch0, Branch1, Branch2, Branch3, Branch4, Branch5
explode_tree_2 = ExplodeTree(Data=excelread_2)  # -> Branch0, Branch1, Branch2, Branch3, Branch4, Branch5
cull_index = CullIndex(List=explode_tree_2.Branch0, Indices=0, Wrap=True)
cull_index_2 = CullIndex(List=explode_tree_2.Branch1, Indices=0, Wrap=True)
cull_index_3 = CullIndex(List=explode_tree_2.Branch2, Indices=0, Wrap=True)
cull_index_4 = CullIndex(List=explode_tree_2.Branch3, Indices=0, Wrap=True)
cull_index_5 = CullIndex(List=explode_tree_2.Branch5, Indices=0, Wrap=True)
cull_index_6 = CullIndex(List=explode_tree_2.Branch4, Indices=0, Wrap=True)
cull_index_7 = CullIndex(List=explode_tree.Branch0, Indices=0, Wrap=True)
cull_index_8 = CullIndex(List=explode_tree.Branch1, Indices=0, Wrap=True)
cull_index_9 = CullIndex(List=explode_tree.Branch2, Indices=0, Wrap=True)
cull_index_10 = CullIndex(List=explode_tree.Branch3, Indices=0, Wrap=True)
uuid = Panel(cull_index)
geom = Panel(cull_index_2)
dtm_z = Panel(cull_index_3)
geb_top = Panel(cull_index_4)
geb_bottom = Panel(cull_index_5)
geb_eg = Panel(cull_index_6)
uuid_2 = Panel(cull_index_7)
volume_over_terrain = Panel(cull_index_8)
floor_area_over_terrain = Panel(cull_index_9)
floor_area___lowest_point = Panel(cull_index_10)
boolean_toggle = BooleanToggle(True)
close_mesh = CloseMesh(Mesh=mesh_2, Quadrangulate=boolean_toggle)  # -> Closed, Amount, Openings, ResultBoolean
member_index = MemberIndex(Set=uuid_2, Member="EEF7864D-4109-4169-95A6-1965D7A7C159")  # -> Index, Count
list_item = ListItem(List=volume_over_terrain, Index=member_index.Index, Wrap=True)
list_item_2 = ListItem(List=floor_area_over_terrain, Index=member_index.Index, Wrap=True)
list_item_3 = ListItem(List=floor_area___lowest_point, Index=member_index.Index, Wrap=True)
curve = Curve(close_mesh.Openings)
mesh_3 = Mesh(close_mesh.Closed)
close_mesh_2 = CloseMesh(Mesh=mesh_3, Quadrangulate=boolean_toggle)  # -> Closed, Amount, Openings, ResultBoolean
mesh_volume = MeshVolume(Mesh=close_mesh_2.Closed)  # -> Volume, Centroid
is_mesh_closed = IsMeshClosed(Mesh=close_mesh_2.Closed)
whole_building_m3 = Panel(mesh_volume.Volume)
panel_2 = Panel(is_mesh_closed)
mesh_split = MeshSplit(Mesh=close_mesh_2.Closed, Splitters=mesh)
mesh_area = MeshArea(Mesh=mesh_split)  # -> Area, Centroid
deconstruct = Deconstruct(Point=mesh_area.Centroid)  # -> XComponent, YComponent, ZComponent
sort_list = SortList(Keys=deconstruct.ZComponent, ValuesValuesA=mesh_split)  # -> Keys, ValuesValuesA

# ---- group: volume above the ground
list_item_4 = ListItem(List=sort_list.ValuesValuesA, Index=1, Wrap=True)

# ---- group: volume underground
list_item_5 = ListItem(List=sort_list.ValuesValuesA, Index=0, Wrap=True)

# ----
close_mesh_3 = CloseMesh(Mesh=list_item_4, Quadrangulate=True)  # -> Closed, Amount, Openings, ResultBoolean
mesh_volume_2 = MeshVolume(Mesh=close_mesh_3.Closed)  # -> Volume, Centroid
is_mesh_closed_2 = IsMeshClosed(Mesh=close_mesh_3.Closed)
panel_3 = Panel(is_mesh_closed_2)

# ---- group: in case of houses on slope / of a volume
bounding_box = BoundingBox(Content=close_mesh_2.Closed, Plane=PlaneXY(0, 0, 0))  # -> Box, Box_2

# ----
mesh_explode = MeshExplode(Mesh=list_item_4, Interpolate=False)
face_normals = FaceNormals(Mesh=list_item_4)  # -> Centers, flatten(Normals)
deconstruct_vector = DeconstructVector(Vector=face_normals.Normals)  # -> XComponent, YComponent, ZComponent
list_item_6 = ListItem(List=mesh_explode, Index=Slider(3, range=0..10), Wrap=True)
member_index_2 = MemberIndex(Set=deconstruct_vector.ZComponent, Member=[Slider(1, range=0..1), Slider(-1, range=-1..1)])  # -> flatten(Index), Count
smaller_than = SmallerThan(FirstNumber=deconstruct_vector.ZComponent, SecondNumber=0.5)  # -> SmallerThan, OrEqualTo
list_item_7 = ListItem(List=mesh_explode, Index=member_index_2.Index, Wrap=True)
invert_boolean = InvertBoolean(Boolean=smaller_than.SmallerThan)  # -> Inverted, Number
area = Area(Geometry=list_item_7)  # -> Area, Centroid

cull_pattern = CullPattern(List=mesh_explode, CullPattern=smaller_than.SmallerThan)
area_2 = Area(Geometry=cull_pattern)  # -> Area, Centroid
mass_addition = MassAddition(Input=area_2.Area)  # -> flatten(Result), PartialResults
walls_above_the_ground_area = Panel(mass_addition.Result)

cull_pattern_2 = CullPattern(List=mesh_explode, CullPattern=invert_boolean.Inverted)
area_3 = Area(Geometry=cull_pattern_2)  # -> Area, Centroid
mass_addition_2 = MassAddition(Input=area_3.Area)  # -> flatten(Result), PartialResults
roof_area = Panel(mass_addition_2.Result)

mass_addition_3 = MassAddition(Input=area.Area)  # -> Result, PartialResults

whole_building_m3_2 = Panel(mesh_volume_2.Volume)
luucy = Panel(list_item)

number_slider = Slider(0.4, range=0..1)

# ---- group: Dach
create_material = CreateMaterial(
    Diffuse=RGB(255, 105, 180),
    Specular=RGB(255, 255, 255),
    Emission=ColourSwatch(SwatchColor=RGB(208, 216, 0)),
    Transparency=0,
    Shine=0)
custom_preview = CustomPreview(Geometry=cull_pattern_2, Material=create_material)

# ---- group: Wandkleidung uber Terrain
colour_swatch = ColourSwatch(SwatchColor=RGB(56, 255, 255))

# ----
custom_preview_materials = CustomPreviewMaterials(Geometry=cull_pattern, DiffuseColor=colour_swatch, Transparency=Slider(0.7, range=0..1))

# ---- group: above ground
bounding_box_2 = BoundingBox(Content=list_item_4, Plane=PlaneXY(0, 0, 0))  # -> Box, Box_2
deconstruct_box = DeconstructBox(Box=bounding_box_2.Box)  # -> Plane, X, Y, Z
deconstruct_domain = DeconstructDomain(Domain=deconstruct_box.Z)  # -> Start, End
subtraction = Subtraction(A=deconstruct_domain.End, B=deconstruct_domain.Start)  # -> flatten(Result)
series = Series(Start=3, Step=3, Count=10)
panel_4 = Panel(subtraction)
larger_than = LargerThan(FirstNumber=panel_4, SecondNumber=series)  # -> flatten(LargerThan), OrEqualTo
panel_5 = Panel(larger_than.LargerThan)

# ---- group: above ground / checks for the number of floors
ghpython_script = GhPythonScript(list=panel_5)  # -> out, a; inputs list: list of Boolean
# ---------- ghpython_script: Python ----------
__author__ = "THINK"
__version__ = "2022.04.04"

import rhinoscriptsyntax as rs

a = 0
for item in range(len(list)):
    if list[item] == True:
        a +=1
# ---------- end ghpython_script ----------

# ----
above_ground_slabs = Panel(ghpython_script.a)

# ---- group: Z small box
number = Number(deconstruct_domain.Start)

# ---- group: underground
face_normals_2 = FaceNormals(Mesh=list_item_5)  # -> Centers, flatten(Normals)
mesh_explode_2 = MeshExplode(Mesh=list_item_5, Interpolate=False)
bounding_box_3 = BoundingBox(Content=list_item_5, Plane=PlaneXY(0, 0, 0))  # -> Box, Box_2
deconstruct_box_2 = DeconstructBox(Box=bounding_box_3.Box)  # -> Plane, X, Y, Z
deconstruct_vector_2 = DeconstructVector(Vector=face_normals_2.Normals)  # -> XComponent, YComponent, ZComponent
deconstruct_domain_2 = DeconstructDomain(Domain=deconstruct_box_2.Z)  # -> Start, End
member_index_3 = MemberIndex(Set=deconstruct_vector_2.ZComponent, Member=[Slider(1, range=0..1), Slider(-1, range=-1..1)])  # -> flatten(Index), Count
subtraction_2 = Subtraction(A=deconstruct_domain_2.End, B=deconstruct_domain_2.Start)  # -> flatten(Result)
list_item_8 = ListItem(List=mesh_explode_2, Index=member_index_3.Index, Wrap=True)
series_2 = Series(Start=2.5, Step=2.5, Count=10)
panel_6 = Panel(subtraction_2)
area_4 = Area(Geometry=list_item_8)  # -> Area, Centroid
larger_than_2 = LargerThan(FirstNumber=panel_6, SecondNumber=series_2)  # -> flatten(LargerThan), OrEqualTo
mass_addition_4 = MassAddition(Input=area_4.Area)  # -> Result, PartialResults
panel_7 = Panel(larger_than_2.LargerThan)

# ---- group: above ground (continued)
multiplication = Multiplication(A=mass_addition_4.Result, B=ghpython_script.a)
round = Round(Number=multiplication)  # -> Nearest, Floor, Ceiling

# ---- group: in case of houses on slope / of other BBs
bounding_box_4 = BoundingBox(Content=[bounding_box_3.Box, bounding_box_2.Box], Plane=PlaneXY(0, 0, 0))  # -> Box, Box_2

# ----
mesh_area_2 = MeshArea(Mesh=mesh_explode_2)  # -> Area, Centroid
mass_addition_5 = MassAddition(Input=mesh_area_2.Area)  # -> Result, PartialResults
subtraction_3 = Subtraction(A=mass_addition_5.Result, B=mass_addition_4.Result)

# ---- group: underground / checks for the number of floors
ghpython_script_2 = GhPythonScript(list=panel_7)  # -> out, a; inputs list: list of Boolean; same code as ghpython_script

# ----
multiplication_2 = Multiplication(A=mass_addition_3.Result, B=ghpython_script_2.a)
round_2 = Round(Number=multiplication_2)  # -> Nearest, Floor, Ceiling
walls_underground_area = Panel(subtraction_3)

floor_area_above_the_ground = Panel(round.Nearest)
luucy_2 = Panel(list_item_2)

# ---- group: Boden
geometry = Geometry(list_item_8)

# ----
cull_index_11 = CullIndex(List=mesh_explode_2, Indices=member_index_3.Index, Wrap=True)

# ---- group: in case of houses on slope
deconstruct_box_3 = DeconstructBox(Box=bounding_box.Box)  # -> Plane, X, Y, Z
deconstruct_box_4 = DeconstructBox(Box=bounding_box_4.Box)  # -> Plane, X, Y, Z
deconstruct_domain_3 = DeconstructDomain(Domain=deconstruct_box_3.Z)  # -> Start, End
deconstruct_domain_4 = DeconstructDomain(Domain=deconstruct_box_4.Z)  # -> Start, End
subtraction_4 = Subtraction(A=deconstruct_domain_4.End, B=deconstruct_domain_4.Start)
subtraction_5 = Subtraction(A=deconstruct_domain_3.End, B=deconstruct_domain_3.Start)
mass_addition_6 = MassAddition(Input=subtraction_4)  # -> Result, PartialResults
subtraction_6 = Subtraction(A=ghpython_script_2.a, B=1)

# ---- group: in case of houses on slope / check for the ground/underground overlap. if bigger than 2.2m
subtraction_7 = Subtraction(A=mass_addition_6.Result, B=subtraction_5)
larger_than_3 = LargerThan(FirstNumber=subtraction_7, SecondNumber=2.2)  # -> LargerThan, OrEqualTo

# ---- group: in case of houses on slope (continued)
stream_filter = StreamFilter(Gate=larger_than_3.LargerThan, Stream0=ghpython_script_2.a, Stream1=subtraction_6)

# ---- group: underground (continued)
multiplication_3 = Multiplication(A=mass_addition_4.Result, B=stream_filter)
round_3 = Round(Number=multiplication_3)  # -> Nearest, Floor, Ceiling

# ---- group: Z big box
number_2 = Number(deconstruct_domain_3.Start)

# ----
floor_area_underground = Panel(round_3.Nearest)
luucy_3 = Panel(list_item_3)
underground_slabs = Panel(stream_filter)

subtraction_8 = Subtraction(A=number_2, B=number)
absolute = Absolute(Value=subtraction_8)
unit_z = UnitZ(Factor=absolute)
move = Move(Geometry=geometry, Motion=unit_z)  # -> Geometry, Transform
linear_array = LinearArray(Geometry=move.Geometry, Direction=unit_z, Count=above_ground_slabs)  # -> Geometry, Transform

# ---- group: Wandkleidung unter Terrain
colour_swatch_2 = ColourSwatch(SwatchColor=RGB(108, 0, 255))

# ----
create_material_2 = CreateMaterial(Diffuse=RGB(255, 105, 180), Specular=RGB(255, 255, 255), Emission=colour_swatch_2, Transparency=number_slider, Shine=0)

# ---- group: Wandkleidung unter Terrain (continued)
custom_preview_2 = CustomPreview(Geometry=cull_index_11, Material=create_material_2)

# ---- group: Decke uber
colour_swatch_3 = ColourSwatch(SwatchColor=RGB(0, 0, 255))

# ----
create_material_3 = CreateMaterial(Diffuse=colour_swatch_3, Specular=RGB(255, 255, 255), Emission=colour_swatch_3, Transparency=number_slider, Shine=0)

# ---- group: Decke uber (continued)
custom_preview_3 = CustomPreview(Geometry=linear_array.Geometry, Material=create_material_3)

# ---- group: Decke unter
colour_swatch_4 = ColourSwatch(SwatchColor=RGB(255, 0, 255))

# ----
create_material_4 = CreateMaterial(Diffuse=RGB(255, 105, 180), Specular=RGB(255, 255, 255), Emission=colour_swatch_4, Transparency=0, Shine=0)

# ---- group: Decke unter (continued)
custom_preview_4 = CustomPreview(Geometry=list_item_8, Material=create_material_4)
