# Grasshopper definition comparison_of_volume_calculation_at_scale.gh (Grasshopper 1.0.7)
# plug-ins: Excel, Pufferfish, MeshEdit Components, Human

panel = Panel("3FCE82CC-86BE-4487-9677-D2B9E654B22F")
file_path = FilePath("C:\Users\THINK\Documents\GitHub\thesis-material-inventory\Luucy\geb_zh_test_building_volume_floor_area.xlsx")
file_path_2 = FilePath("C:\Users\THINK\Documents\GitHub\thesis-material-inventory\Luucy\geb_zh_test_1m_raster.xlsx")

# ---- group: all buildings
mesh = Mesh(flatten([<mesh referenced from the Rhino model> x59]))

# ---- group: terrain
mesh_2 = Mesh(<mesh referenced from the Rhino model>)

# ----
mesh_3 = Mesh(<mesh referenced from the Rhino model>)
rebuild_mesh = RebuildMesh(
    Mesh=mesh,
    RebuildNormals=True,
    CullUnused=True,
    UnifyNormals=False,
    FlipNormals=False,
    IdenticalCombine=True,
    WeldVertices=0.02)

# ---- group: double mesh closing, METHOD 1
boolean_toggle = BooleanToggle(True)  # disabled
close_mesh = CloseMesh(Mesh=rebuild_mesh, Quadrangulate=boolean_toggle)  # -> Closed, Amount, Openings, ResultBoolean; disabled
mesh_4 = Mesh(close_mesh.Closed)  # disabled
close_mesh_2 = CloseMesh(Mesh=mesh_4, Quadrangulate=boolean_toggle)  # -> Closed, Amount, Openings, ResultBoolean; disabled
is_mesh_closed = IsMeshClosed(Mesh=close_mesh_2.Closed)  # disabled
curve = Curve(close_mesh_2.Openings)  # disabled

# ----
excelread = ExcelRead(Start=Toggle(True), FilePath=file_path, SheetName="Swissbuilding Analytics - buili", Range="A1:D83")
excelread_2 = ExcelRead(Start=Toggle(True), FilePath=file_path_2, SheetName="geb_zh_test_1m_raster", Range="A1:F11923")
explode_tree = ExplodeTree(Data=excelread)  # -> Branch0, Branch1, Branch2, Branch3, Branch4, Branch5
explode_tree_2 = ExplodeTree(Data=excelread_2)  # -> Branch0, Branch1, Branch2, Branch3, Branch4, Branch5
cull_index = CullIndex(List=explode_tree_2.Branch0, Indices=0, Wrap=True)
cull_index_2 = CullIndex(List=explode_tree_2.Branch1, Indices=0, Wrap=True)
cull_index_3 = CullIndex(List=explode_tree_2.Branch2, Indices=0, Wrap=True)
cull_index_4 = CullIndex(List=explode_tree_2.Branch3, Indices=0, Wrap=True)
cull_index_5 = CullIndex(List=explode_tree_2.Branch5, Indices=0, Wrap=True)
cull_index_6 = CullIndex(List=explode_tree_2.Branch4, Indices=0, Wrap=True)
cull_index_7 = CullIndex(List=explode_tree.Branch0, Indices=0, Wrap=True)
cull_index_8 = CullIndex(List=explode_tree.Branch1, Indices=0, Wrap=True)
cull_index_9 = CullIndex(List=explode_tree.Branch2, Indices=0, Wrap=True)
cull_index_10 = CullIndex(List=explode_tree.Branch3, Indices=0, Wrap=True)
list_item = ListItem(List=rebuild_mesh, Index=Slider(8, range=0..100), Wrap=True)
uuid = Panel(cull_index)
geom = Panel(cull_index_2)
dtm_z = Panel(cull_index_3)
geb_top = Panel(cull_index_4)
geb_bottom = Panel(cull_index_5)
geb_eg = Panel(cull_index_6)
uuid_2 = Panel(cull_index_7)
volume_over_terrain = Panel(cull_index_8)
floor_area_over_terrain = Panel(cull_index_9)
floor_area___lowest_point = Panel(cull_index_10)
member_index = MemberIndex(Set=uuid_2, Member="EEF7864D-4109-4169-95A6-1965D7A7C159")  # -> Index, Count
list_item_2 = ListItem(List=volume_over_terrain, Index=member_index.Index, Wrap=True)
list_item_3 = ListItem(List=floor_area_over_terrain, Index=member_index.Index, Wrap=True)
list_item_4 = ListItem(List=floor_area___lowest_point, Index=member_index.Index, Wrap=True)
ghpython_script = GhPythonScript(x=rebuild_mesh)  # -> out, a; inputs x: Mesh
# ---------- ghpython_script: Python ----------
__author__ = "THINK"
__version__ = "2022.04.10"

import rhinoscriptsyntax as rs
import Rhino as rc

rc.Geometry.Mesh.FillHoles(x)
a=x
# ---------- end ghpython_script ----------
is_mesh_closed_2 = IsMeshClosed(Mesh=ghpython_script.a)
geometry = Geometry(ghpython_script.a)
ghpython_script_2 = GhPythonScript(x=is_mesh_closed)  # -> out, a, b; inputs x: list
# ---------- ghpython_script_2: Python ----------
__author__ = "THINK"
__version__ = "2022.04.10"

import rhinoscriptsyntax as rs

a=0
b=0
for i in x:
    if i == True:
        a+=1
    else:
        b+=1
# ---------- end ghpython_script_2 ----------
ghpython_script_3 = GhPythonScript(x=is_mesh_closed_2)  # -> out, a, b; inputs x: list; same code as ghpython_script_2
invert_boolean = InvertBoolean(Boolean=is_mesh_closed_2)  # -> Inverted, Number
cull_pattern = CullPattern(List=geometry, CullPattern=invert_boolean.Inverted)
rebuild_mesh_2 = RebuildMesh(
    Mesh=cull_pattern,
    RebuildNormals=False,
    CullUnused=True,
    UnifyNormals=False,
    FlipNormals=False,
    IdenticalCombine=True,
    WeldVertices=0.2)
panel_2 = Panel(is_mesh_closed_2)
true = Panel(ghpython_script_2.a)
false = Panel(ghpython_script_2.b)
false_2 = Panel(ghpython_script_3.b)
true_2 = Panel(ghpython_script_3.a)
ghpython_script_4 = GhPythonScript(x=rebuild_mesh_2)  # -> out, a; inputs x: Mesh; same code as ghpython_script
is_mesh_closed_3 = IsMeshClosed(Mesh=ghpython_script_4.a)
cull_pattern_2 = CullPattern(List=geometry, CullPattern=panel_2)
invert_boolean_2 = InvertBoolean(Boolean=is_mesh_closed_3)  # -> Inverted, Number
cull_pattern_3 = CullPattern(List=ghpython_script_4.a, CullPattern=is_mesh_closed_3)
merge = Merge(Data1=cull_pattern_2, Data2=cull_pattern_3)
list_item_5 = ListItem(List=cull_pattern_2, Index=Slider(34, range=0..100), Wrap=True)
mesh_split = MeshSplit(Mesh=flatten(merge), Splitters=mesh_2)
mesh_area = MeshArea(Mesh=mesh_split)  # -> Area, Centroid
panel_3 = Panel(mesh_split)
deconstruct = Deconstruct(Point=mesh_area.Centroid)  # -> XComponent, YComponent, ZComponent
sort_list = SortList(Keys=deconstruct.ZComponent, ValuesValuesA=mesh_split)  # -> Keys, ValuesValuesA

# ---- group: volume above the ground
list_item_6 = ListItem(List=sort_list.ValuesValuesA, Index=1, Wrap=True)

# ---- group: volume underground
list_item_7 = ListItem(List=sort_list.ValuesValuesA, Index=0, Wrap=True)

# ----
close_mesh_3 = CloseMesh(Mesh=list_item_6, Quadrangulate=True)  # -> Closed, Amount, Openings, ResultBoolean
panel_4 = Panel(list_item_7)
mesh_volume = MeshVolume(Mesh=close_mesh_3.Closed)  # -> Volume, Centroid
is_mesh_closed_4 = IsMeshClosed(Mesh=close_mesh_3.Closed)
panel_5 = Panel(mesh_volume.Volume)

# ---- group: in case of houses on slope / of a volume
bounding_box = BoundingBox(Content=graft(merge), Plane=PlaneXY(0, 0, 0))  # -> Box, Box_2

# ----
mesh_explode = MeshExplode(Mesh=list_item_6, Interpolate=False)
face_normals = FaceNormals(Mesh=list_item_6)  # -> Centers, Normals
deconstruct_vector = DeconstructVector(Vector=face_normals.Normals)  # -> XComponent, YComponent, ZComponent
list_item_8 = ListItem(List=mesh_explode, Index=Slider(3, range=0..10), Wrap=True)
member_index_2 = MemberIndex(Set=deconstruct_vector.ZComponent, Member=[Slider(1, range=0..1), Slider(-1, range=-1..1)])  # -> flatten(Index), Count
absolute = Absolute(Value=deconstruct_vector.ZComponent)
smaller_than = SmallerThan(FirstNumber=absolute, SecondNumber=0.5)  # -> SmallerThan, OrEqualTo
list_item_9 = ListItem(List=mesh_explode, Index=member_index_2.Index, Wrap=True)
area = Area(Geometry=list_item_9)  # -> Area, Centroid
invert_boolean_3 = InvertBoolean(Boolean=smaller_than.SmallerThan)  # -> Inverted, Number
mass_addition = MassAddition(Input=area.Area)  # -> Result, PartialResults

cull_pattern_4 = CullPattern(List=mesh_explode, CullPattern=smaller_than.SmallerThan)
area_2 = Area(Geometry=cull_pattern_4)  # -> Area, Centroid
mass_addition_2 = MassAddition(Input=area_2.Area)  # -> flatten(Result), PartialResults
walls_above_the_ground_area = Panel(mass_addition_2.Result)

cull_pattern_5 = CullPattern(List=mesh_explode, CullPattern=invert_boolean_3.Inverted)
area_3 = Area(Geometry=cull_pattern_5)  # -> Area, Centroid
mass_addition_3 = MassAddition(Input=area_3.Area)  # -> flatten(Result), PartialResults
roof_area = Panel(mass_addition_3.Result)

luucy = Panel(list_item_2)

unit_z = UnitZ(Factor="3")
number_slider = Slider(0.4, range=0..1)

# ---- group: Wandkleidung uber Terrain
custom_preview_materials = CustomPreviewMaterials(Geometry=cull_pattern_4, DiffuseColor=ColourSwatch(SwatchColor=RGB(56, 255, 255)), Transparency=Slider(0.7, range=0..1))

# ---- group: Dach
create_material = CreateMaterial(
    Diffuse=RGB(255, 105, 180),
    Specular=RGB(255, 255, 255),
    Emission=ColourSwatch(SwatchColor=RGB(208, 216, 0)),
    Transparency=0,
    Shine=0)
custom_preview = CustomPreview(Geometry=cull_pattern_5, Material=create_material)

# ---- group: not working
cull_pattern_6 = CullPattern(List=ghpython_script_4.a, CullPattern=invert_boolean_2.Inverted)
create_material_2 = CreateMaterial(
    Diffuse=RGB(255, 105, 180),
    Specular=RGB(255, 255, 255),
    Emission=ColourSwatch(SwatchColor=RGB(255, 0, 0)),
    Transparency=0,
    Shine=0)
custom_preview_2 = CustomPreview(Geometry=cull_pattern_6, Material=create_material_2)

# ---- group: above ground
bounding_box_2 = BoundingBox(Content=list_item_6, Plane=PlaneXY(0, 0, 0))  # -> Box, Box_2
deconstruct_box = DeconstructBox(Box=bounding_box_2.Box)  # -> Plane, X, Y, Z
deconstruct_domain = DeconstructDomain(Domain=deconstruct_box.Z)  # -> Start, End
subtraction = Subtraction(A=deconstruct_domain.End, B=deconstruct_domain.Start)
series = Series(Start=3, Step="3", Count=10)
panel_6 = Panel(subtraction)
larger_than = LargerThan(FirstNumber=panel_6, SecondNumber=series)  # -> LargerThan, OrEqualTo
panel_7 = Panel(larger_than.LargerThan)

# ---- group: above ground / checks for the number of floors
ghpython_script_5 = GhPythonScript(list=panel_7)  # -> out, a; inputs list: list of Boolean
# ---------- ghpython_script_5: Python ----------
__author__ = "Natalia"
__version__ = "2022.04.04"

import rhinoscriptsyntax as rs

a = 0
for item in range(len(list)):
    if list[item] == True:
        a +=1
# ---------- end ghpython_script_5 ----------

# ----
above_ground_slabs = Panel(ghpython_script_5.a)

# ---- group: Z small box
number = Number(deconstruct_domain.Start)

# ----
panel_8 = Panel(number)

# ---- group: underground
number_slider_2 = Slider(-1, range=-1..1)
face_normals_2 = FaceNormals(Mesh=list_item_7)  # -> Centers, Normals
mesh_explode_2 = MeshExplode(Mesh=list_item_7, Interpolate=False)
bounding_box_3 = BoundingBox(Content=list_item_7, Plane=PlaneXY(0, 0, 0))  # -> Box, Box_2
deconstruct_box_2 = DeconstructBox(Box=bounding_box_3.Box)  # -> Plane, X, Y, Z
deconstruct_vector_2 = DeconstructVector(Vector=face_normals_2.Normals)  # -> XComponent, YComponent, ZComponent
deconstruct_domain_2 = DeconstructDomain(Domain=deconstruct_box_2.Z)  # -> Start, End
member_index_3 = MemberIndex(Set=deconstruct_vector_2.ZComponent, Member=Slider(1, range=0..1))  # -> Index, Count
subtraction_2 = Subtraction(A=deconstruct_domain_2.End, B=deconstruct_domain_2.Start)  # -> flatten(Result)
list_item_10 = ListItem(List=mesh_explode_2, Index=member_index_3.Index, Wrap=True)
series_2 = Series(Start=2.5, Step=2.5, Count=10)
panel_9 = Panel(subtraction_2)
larger_than_2 = LargerThan(FirstNumber=panel_9, SecondNumber=series_2)  # -> flatten(LargerThan), OrEqualTo
panel_10 = Panel(larger_than_2.LargerThan)

# ----
merge_2 = Merge(Data1=bounding_box_2.Box, Data2=bounding_box_3.Box)

# ---- group: in case of houses on slope / of other BBs
bounding_box_4 = BoundingBox(Content=merge_2, Plane=PlaneXY(0, 0, 0))  # -> Box, Box_2

# ----
list_item_11 = ListItem(List=mesh_explode_2, Index=Slider(20, range=0..100), Wrap=True)
member_index_4 = MemberIndex(Set=deconstruct_vector_2.ZComponent, Member=number_slider_2)  # -> Index, Count
panel_11 = Panel(deconstruct_vector_2.ZComponent)
list_item_12 = ListItem(List=mesh_explode_2, Index=member_index_4.Index, Wrap=True)
merge_3 = Merge(Data1=list_item_10, Data2=list_item_12)
mesh_area_2 = MeshArea(Mesh=mesh_explode_2)  # -> Area, Centroid
mesh_join = MeshJoin(Meshes=merge_3)
mass_addition_4 = MassAddition(Input=mesh_area_2.Area)  # -> Result, PartialResults

# ---- group: underground / checks for the number of floors
ghpython_script_6 = GhPythonScript(list=panel_10)  # -> out, a; inputs list: list of Boolean
# ---------- ghpython_script_6: Python ----------
__author__ = "THINK"
__version__ = "2022.04.04"

import rhinoscriptsyntax as rs

a = 0
for item in range(len(list)):
    if list[item] == True:
        a +=1
# ---------- end ghpython_script_6 ----------

# ----
multiplication = Multiplication(A=mass_addition.Result, B=ghpython_script_6.a)
round = Round(Number=multiplication)  # -> Nearest, Floor, Ceiling

# ---- group: Boden
geometry_2 = Geometry(mesh_join)

# ----
panel_12 = Panel(geometry_2)
cull_index_11 = CullIndex(List=mesh_explode_2, Indices=member_index_3.Index, Wrap=True)

# ---- group: in case of houses on slope
deconstruct_box_3 = DeconstructBox(Box=bounding_box.Box)  # -> Plane, X, Y, Z
deconstruct_box_4 = DeconstructBox(Box=bounding_box_4.Box)  # -> Plane, X, Y, Z
deconstruct_domain_3 = DeconstructDomain(Domain=deconstruct_box_3.Z)  # -> Start, End
deconstruct_domain_4 = DeconstructDomain(Domain=deconstruct_box_4.Z)  # -> Start, End
subtraction_3 = Subtraction(A=deconstruct_domain_4.End, B=deconstruct_domain_4.Start)
subtraction_4 = Subtraction(A=deconstruct_domain_3.End, B=deconstruct_domain_3.Start)
mass_addition_5 = MassAddition(Input=subtraction_3)  # -> Result, PartialResults
subtraction_5 = Subtraction(A=ghpython_script_6.a, B=1)

# ---- group: in case of houses on slope / check for the ground/underground overlap. if bigger than 2.2m
subtraction_6 = Subtraction(A=mass_addition_5.Result, B=subtraction_4)
larger_than_3 = LargerThan(FirstNumber=subtraction_6, SecondNumber=2.2)  # -> LargerThan, OrEqualTo

# ---- group: in case of houses on slope (continued)
stream_filter = StreamFilter(Gate=larger_than_3.LargerThan, Stream0=ghpython_script_6.a, Stream1=subtraction_5)

# ---- group: underground (continued)
area_4 = Area(Geometry=[list_item_10, list_item_12])  # -> Area, Centroid
mass_addition_6 = MassAddition(Input=area_4.Area)  # -> Result, PartialResults
multiplication_2 = Multiplication(A=mass_addition_6.Result, B=stream_filter)
round_2 = Round(Number=multiplication_2)  # -> Nearest, Floor, Ceiling

# ---- group: above ground (continued)
multiplication_3 = Multiplication(A=mass_addition_6.Result, B=ghpython_script_5.a)
round_3 = Round(Number=multiplication_3)  # -> Nearest, Floor, Ceiling

# ----
subtraction_7 = Subtraction(A=mass_addition_4.Result, B=mass_addition_6.Result)
walls_underground_area = Panel(subtraction_7)

floor_area_above_the_ground = Panel(round_3.Nearest)
luucy_2 = Panel(list_item_3)

# ---- group: Z big box
number_2 = Number(deconstruct_domain_3.Start)

# ----
panel_13 = Panel(number_2)

floor_area_underground = Panel(round_2.Nearest)
luucy_3 = Panel(list_item_4)
underground_slabs = Panel(stream_filter)

subtraction_8 = Subtraction(A=number_2, B=number)
absolute_2 = Absolute(Value=subtraction_8)
unit_z_2 = UnitZ(Factor=absolute_2)
move = Move(Geometry=geometry_2, Motion=unit_z_2)  # -> Geometry, Transform
linear_array = LinearArray(Geometry=move.Geometry, Direction=unit_z, Count=above_ground_slabs)  # -> Geometry, Transform

# ---- group: Wandkleidung unter Terrain
colour_swatch = ColourSwatch(SwatchColor=RGB(158, 151, 194))

# ----
create_material_3 = CreateMaterial(Diffuse=RGB(255, 105, 180), Specular=RGB(255, 255, 255), Emission=colour_swatch, Transparency=number_slider, Shine=0)

# ---- group: Wandkleidung unter Terrain (continued)
custom_preview_3 = CustomPreview(Geometry=cull_index_11, Material=create_material_3)

# ---- group: Decke uber
colour_swatch_2 = ColourSwatch(SwatchColor=RGB(0, 0, 255))

# ----
create_material_4 = CreateMaterial(Diffuse=colour_swatch_2, Specular=RGB(255, 255, 255), Emission=colour_swatch_2, Transparency=number_slider, Shine=0)

# ---- group: Decke uber (continued)
custom_preview_4 = CustomPreview(Geometry=linear_array.Geometry, Material=create_material_4)

# ---- group: Decke unter
colour_swatch_3 = ColourSwatch(SwatchColor=RGB(11, 255, 0))

# ----
create_material_5 = CreateMaterial(Diffuse=RGB(255, 105, 180), Specular=RGB(255, 255, 255), Emission=colour_swatch_3, Transparency=0, Shine=0)

# ---- group: Decke unter (continued)
custom_preview_5 = CustomPreview(Geometry=mesh_join, Material=create_material_5)
