# Grasshopper definition volume.gh (Grasshopper 1.0.7)
# plug-ins: Kangaroo2 Components, Pufferfish

# ---- group: floor
mesh = Mesh(<mesh referenced from the Rhino model>)

# ---- group: roof
mesh_2 = Mesh([<mesh referenced from the Rhino model> x3])

# ---- group: terrain
mesh_3 = Mesh([<mesh referenced from the Rhino model> x2])

# ----
number_slider = Slider(0.5, range=0..1)
square = Square(Value=number_slider)
pi = Pi(Factor=1)
multiplication = Multiplication(A=pi, B=square)

mesh_shadow = MeshShadow(Mesh=mesh, Light=Vector(0, 0, -1), Plane=PlaneXY(0, 0, 0))
mesh_join = MeshJoin(Meshes=mesh_2)
curve = Curve(mesh_shadow)
fit_curve = FitCurve(Curve=curve, Tolerance=Slider(0.5, range=0..1))
surface = Surface(fit_curve)

area = Area(Geometry=surface)  # -> Area, Centroid
division = Division(A=area.Area, B=multiplication)
round_to_decimal_place = RoundToDecimalPlace(NumberX=division, DecimalPlace=0, RoundType=0)  # -> Rounded, Difference

circles_count = Panel(round_to_decimal_place.Rounded)
populate_geometry = PopulateGeometry(Geometry=surface, Count=circles_count, Seed=0)
onmesh = OnMesh(Points=populate_geometry, Mesh=surface, Strength=1)
sc = SphereCollide(Points=populate_geometry, Radius=Slider(0.5, range=0..1), Strength=1)
zombiesolver = ZombieSolver(GoalObjects=[onmesh, sc], Threshold=1e-10, Tolerance=0.01, MaxIterations=50000)  # -> I, V, O
cull_duplicates = CullDuplicates(Points=zombiesolver.V, Tolerance=0.1, CullMode=3)  # -> Points, Indices, Valence
cir = Circle(Plane=zombiesolver.V, Radius=number_slider)
point = Point(Point(0, 0, 1))
vector = Vector(point)
project_point = ProjectPoint(Point=cull_duplicates.Points, Direction=vector, Geometry=mesh_join)  # -> Point, Index
project_point_2 = ProjectPoint(Point=cull_duplicates.Points, Direction=vector, Geometry=mesh_3)  # -> Point, Index
line = Line(StartPoint=project_point_2.Point, EndPoint=project_point.Point)
length = Length(Curve=line)
replace_nulls = ReplaceNulls(Items=length, Replacements="0")  # -> Items, Count
mass_addition = MassAddition(Input=replace_nulls.Items)  # -> Result, PartialResults
multiplication_2 = Multiplication(A=mass_addition.Result, B=multiplication)  # -> simplify(Result)
round = Round(Number=multiplication_2)  # -> simplify(flatten(Nearest)), Floor, Ceiling
m3 = Panel(round.Nearest)
